# Dynamo graph Tunnel Clearance11 - South (2).dyn "Tunnel Clearance11 - South" (Dynamo 2.12.0.5650)

file_path = Filename("C:\Users\ayman\OneDrive\Desktop\Book1.csv")  # graph input

# group: Create Rec Tunnel Geometry
cad_sweep = DSModelElementSelection()  # nothing selected; graph input
geometry = Element.Geometry(element=cad_sweep)
code_block = CodeBlock { 0; 2; }
getItemAtIndex = List.GetItemAtIndex(list=geometry, index=code_block.out0)
getItemAtIndex_2 = List.GetItemAtIndex(list=geometry, index=code_block.out1)
bySweep = Surface.BySweep(profile=getItemAtIndex_2, path=getItemAtIndex)
explode = Geometry.Explode(geometry=bySweep)
code_block_2 = CodeBlock { 4; }
chop = List.Chop(list=explode, lengths=code_block_2)
code_block_3 = CodeBlock { 3; }
getItemAtIndex_3 = List.GetItemAtIndex(list=chop, index=code_block_3, lacing=Longest)
byJoinedSurfaces = PolySurface.ByJoinedSurfaces(surfaces=getItemAtIndex_3)

# group: Create Intersection Surfaces at the Designed Intervals
length = Curve.Length(curve=getItemAtIndex)
code_block_4 = CodeBlock(a=length) { 0..a..5; }
pointAtSegmentLength = Curve.PointAtSegmentLength(curve=getItemAtIndex, segmentLength=code_block_4)
flatten = List.Flatten(list=pointAtSegmentLength)
code_block_5 = CodeBlock { 10; }
code_block_6 = CodeBlock { 1; }
shiftIndices = List.ShiftIndices(list=flatten, amount=code_block_6)
restOfItems = List.RestOfItems(list=shiftIndices)
restOfItems_2 = List.RestOfItems(list=flatten)
byTwoPoints = Vector.ByTwoPoints(start=restOfItems, end=restOfItems_2)
byCenterPointRadiusNormal = Circle.ByCenterPointRadiusNormal(centerPoint=flatten, radius=code_block_5, normal=byTwoPoints)
byPatch = Surface.ByPatch(closedCurve=byCenterPointRadiusNormal)

intersect = Geometry.Intersect(geometry=byPatch, other=byJoinedSurfaces)
byJoinedCurves = PolyCurve.ByJoinedCurves(curves=intersect, lacing=Longest)

# group: Create Arc Tunnel Geometry
cad_circles = DSModelElementSelection()  # nothing selected; graph input
geometry_2 = Element.Geometry(element=cad_circles)
code_block_7 = CodeBlock { 1; }
shiftIndices_2 = List.ShiftIndices(list=geometry_2, amount=code_block_7)
flatten_2 = List.Flatten(list=shiftIndices_2)
restOfItems_3 = List.RestOfItems(list=flatten_2)
select_model_element = DSModelElementSelection()  # nothing selected; graph input
geometry_3 = Element.Geometry(element=select_model_element)
ZAxis = Vector.ZAxis()
code_block_8 = CodeBlock { 50; }
extrude = Curve.Extrude(curve=geometry_3, direction=ZAxis, distance=code_block_8)
intersect_2 = Geometry.Intersect(geometry=restOfItems_3, other=extrude, lacing=Longest)
flatten_3 = List.Flatten(list=intersect_2)
UVParameterAtPoint = Surface.UVParameterAtPoint(surface=extrude, point=flatten_3, lacing=Longest)
V = UV.V(uV=UVParameterAtPoint)
sortIndexByValue = List.SortIndexByValue(list=V)
getItemAtIndex_4 = List.GetItemAtIndex(list=restOfItems_3, index=sortIndexByValue)
byLoft = Surface.ByLoft(crossSections=getItemAtIndex_4)

intersect_3 = Geometry.Intersect(geometry=byLoft, other=byPatch)
startPoint = Curve.StartPoint(curve=intersect_3)
byControlPoints = NurbsCurve.ByControlPoints(points=startPoint)
ZAxis_2 = Vector.ZAxis()
code_block_9 = CodeBlock { -0.7; }
translate = Geometry.Translate(geometry=byJoinedSurfaces, direction=ZAxis_2, distance=code_block_9)

# group: Right Side
startPoint_2 = Curve.StartPoint(curve=byJoinedCurves)
closestPointTo = Geometry.ClosestPointTo(geometry=byControlPoints, other=startPoint_2)
clean = List.Clean(list=closestPointTo)
byTwoPoints_2 = Vector.ByTwoPoints(start=startPoint_2, end=clean)
code_block_10 = CodeBlock { 4; }
byStartPointDirectionLength = Line.ByStartPointDirectionLength(startPoint=startPoint_2, direction=byTwoPoints_2, length=code_block_10)
doesIntersect = Geometry.DoesIntersect(geometry=byStartPointDirectionLength, other=translate)
distanceTo = Geometry.DistanceTo(geometry=startPoint_2, other=clean)
code_block_11 = CodeBlock(a=distanceTo) { a*1000; }
code_block_12 = CodeBlock { 1; }
round = Math.Round(number=code_block_11, digits=code_block_12)
code_block_13 = CodeBlock(a=round) { a*1; }
code_block_14 = CodeBlock(a=round) { a*-1; }
if_ = If(test=doesIntersect, true=code_block_13, false=code_block_14)

# group: right
watch = Watch(if_)
maximumItem = List.MaximumItem(list=watch)
minimumItem = List.MinimumItem(list=watch)

exportCSV = Data.ExportCSV(filePath=file_path, data=watch)
code_block_15 = CodeBlock { "Negative is Inside"; }

# group: Left Side
endPoint = Curve.EndPoint(curve=byJoinedCurves)
closestPointTo_2 = Geometry.ClosestPointTo(geometry=byControlPoints, other=endPoint)
clean_2 = List.Clean(list=closestPointTo_2)
byTwoPoints_3 = Vector.ByTwoPoints(start=endPoint, end=clean_2)
code_block_16 = CodeBlock { 4; }
byStartPointDirectionLength_2 = Line.ByStartPointDirectionLength(startPoint=endPoint, direction=byTwoPoints_3, length=code_block_16)
doesIntersect_2 = Geometry.DoesIntersect(geometry=byStartPointDirectionLength_2, other=translate)
distanceTo_2 = Geometry.DistanceTo(geometry=endPoint, other=clean_2)
code_block_17 = CodeBlock(a=distanceTo_2) { a*1000; }
code_block_18 = CodeBlock { 1; }
round_2 = Math.Round(number=code_block_17, digits=code_block_18)
code_block_19 = CodeBlock(a=round_2) { a*1; }
code_block_20 = CodeBlock(a=round_2) { a*-1; }
if_2 = If(test=doesIntersect_2, true=code_block_19, false=code_block_20)

# group: left
watch_2 = Watch(if_2)
maximumItem_2 = List.MaximumItem(list=watch_2)
minimumItem_2 = List.MinimumItem(list=watch_2)
